# Dynamo graph CREATE_SHEETS_WITH_VIEWS_FROM_LAYOUTS_.dyn (Dynamo 3.3.0.6316)

# group: HOW TO USE: > What this does: Creates a sheet for every Level in the model, with a structural plan view placed on each one. Before you run: 1.Make sure the arch Levels have been copy/monitored into this project. 2.Check the model has no existing sheets numbered SP-101 upwards. If it does, change the start number in Step 3. 3.Check the titleblock in Step 5 is the right one for this project. 4.Make sure the run mode at the bottom is set to Manual.
# note: Note 1

# group: HOW TO USE: > How to use it: Press Run once. You'll get one sheet per Level, named after the Level, numbered SP-101, SP-102, and so on. To change the numbering: In Step 3, edit the start number (currently 101) or the prefix (currently "SP-"). Warning: Only run this once. Running it a second time creates duplicate views and fails on the sheet numbers, because those numbers are already taken. If a run fails partway, delete the sheets and views it made before trying again. Note: One Level in the model can't take a structural plan view, so you get 21 sheets from 22 Levels. This is expected. Next to the 101; Code Block in Step 3: Sheet numbering starts here. Change this if these numbers are already used. Next to Family Types in Step 5: "Pick the titleblock for this project.
# note: Note 2

# group: Step 1: Find all the Layout views in the model
code_block = CodeBlock { "Views"; }
byName = Category.ByName(name=code_block)
all_elements_of_category = ElementsOfCategory(Category=byName)
name = Element.Name(element=all_elements_of_category)
code_block_2 = CodeBlock { "Layout."; }
boolean = BoolSelector(true)
endsWith = String.EndsWith(string=name, searchFor=code_block_2, ignoreCase=boolean)
filterByBoolMask = List.FilterByBoolMask(list=all_elements_of_category, mask=endsWith)
watch = Watch(filterByBoolMask.in)

# group: Step 2: Build the sheet names from the Level names
name_2 = Element.Name(element=filterByBoolMask.in)
watch_2 = Watch(name_2)
code_block_3 = CodeBlock(name=name_2) { name + "STRUCTURAL PLAN"; }

# group: Step 3: Generate the sheet numbers
code_block_4 = CodeBlock { 2001; }
count = List.Count(list=filterByBoolMask.in)
code_block_5 = CodeBlock { 1; }
sequence = Sequence(start=code_block_4, amount=count, step=code_block_5)
watch_3 = Watch(sequence)
code_block_6 = CodeBlock(number=sequence) { "6000084-HH-01-00-DR-SE-" + number; }
watch_4 = Watch(code_block_6)
watch_5 = Watch(count)

# group: Step 4: Create a plan view for each Level
code_block_7 = CodeBlock { 1; }
chop = List.Chop(list=filterByBoolMask.in, lengths=code_block_7)
watch_6 = Watch(chop)

# group: Step 5: Create the sheets and place the views
family_types = FamilyTypes("HH_A1_V2:Type 1")
byNameNumberTitleBlockAndViews = Sheet.ByNameNumberTitleBlockAndViews(sheetName=code_block_3, sheetNumber=code_block_6, titleBlockFamilyType=family_types, views=chop@L1, lacing=Longest)
watch_7 = Watch(byNameNumberTitleBlockAndViews)
