# Dynamo graph Create_Structural_Plan_Views_From_Levels.dyn (Dynamo 3.3.0.6316)

# group: HOW TO USE: > What this does: Makes a structural plan view for every Level in the model. Before you run: Make sure the arch levels have been copy/monitored into this project first. Check the Watch box to see which Levels will get views. Warning: This makes a view for every Level, including parapet and T.O. Steel levels. Delete any you don't want afterwards. Running it twice will error on Levels that already have a view.
# note: Note 1

# group: Step 1: Find all Levels in the model
code_block = CodeBlock { "Levels"; }
byName = Category.ByName(name=code_block)
all_elements_of_category = ElementsOfCategory(Category=byName)
watch = Watch(all_elements_of_category)

# group: Step 2: Make a structural plan view for each Level
byLevel = StructuralPlanView.ByLevel(level=all_elements_of_category)
