# Dynamo graph Place_Sections_On_Sheets_Grid.dyn
# author: Muhammad Hindichristine
# Place multiple section views on Revit sheets in a configurable grid layout using only visual nodes - FULLY CONNECTED AND READY TO RUN

codeBlock = CodeBlock(X=0, Y=0, IsVisible=true, IsUpstreamVisible=true, DownstreamNodeIds=["1"], Excluded=false, HasUI=false, Frozen=false, UsingDefaultValue=false, Name="Sheets Category") { "Sheets"; }
custom = Custom[](InPortData=[{Name: "Category Name", Description: "The built-in category name", TypeName: "string", TypeRank: -1, DefaultValue: "Sheets", DefaultValueEnabled: true}], X=100, Y=0, IsVisible=true, IsUpstreamVisible=true, UpstreamNodeIds=["0"], DownstreamNodeIds=["2"], Excluded=false, HasUI=false, Frozen=false, UsingDefaultValue=false, Name="Get Sheets Category")  # Get a category from the document by name
custom_2 = Custom[](InPortData=[{Name: "category", Description: "The Category", TypeName: "var", TypeRank: -1, DefaultValue: null, DefaultValueEnabled: false}], X=200, Y=0, IsVisible=true, IsUpstreamVisible=true, UpstreamNodeIds=["1"], DownstreamNodeIds=["14", "11"], Excluded=false, HasUI=false, Frozen=false, UsingDefaultValue=false, Name="All Sheets")  # unwired: category
codeBlock_2 = CodeBlock(X=0, Y=100, IsVisible=true, IsUpstreamVisible=true, DownstreamNodeIds=["4"], Excluded=false, HasUI=false, Frozen=false, UsingDefaultValue=false, Name="Sections Category") { "Section Views"; }
custom_3 = Custom[](InPortData=[{Name: "Category Name", Description: "The built-in category name", TypeName: "string", TypeRank: -1, DefaultValue: "Sheets", DefaultValueEnabled: true}], X=100, Y=100, IsVisible=true, IsUpstreamVisible=true, UpstreamNodeIds=["3"], DownstreamNodeIds=["5"], Excluded=false, HasUI=false, Frozen=false, UsingDefaultValue=false, Name="Get Sections Category")
custom_4 = Custom[](InPortData=[{Name: "category", Description: "The Category", TypeName: "var", TypeRank: -1, DefaultValue: null, DefaultValueEnabled: false}], X=200, Y=100, IsVisible=true, IsUpstreamVisible=true, UpstreamNodeIds=["4"], DownstreamNodeIds=["6", "9"], Excluded=false, HasUI=false, Frozen=false, UsingDefaultValue=false, Name="All Section Views")  # unwired: category
codeBlock_3 = CodeBlock(X=350, Y=100, IsVisible=true, IsUpstreamVisible=true, UpstreamNodeIds=["5"], DownstreamNodeIds=["7"], Excluded=false, HasUI=false, Frozen=false, UsingDefaultValue=false, Name="Get Section Names") { sections.Name; }  # unwired: sections
codeBlock_4 = CodeBlock(X=300, Y=200, IsVisible=true, IsUpstreamVisible=true, DownstreamNodeIds=["8"], Excluded=false, HasUI=false, Frozen=false, UsingDefaultValue=false, Name="Filter Keyword") { "Wall"; }
custom_5 = Custom[](X=450, Y=150, IsVisible=true, IsUpstreamVisible=true, UpstreamNodeIds=["6", "7"], DownstreamNodeIds=["9"], Excluded=false, HasUI=false, Frozen=false, UsingDefaultValue=false, Name="String.Contains")  # unwired: str, searchFor, ignoreCase
custom_6 = Custom[](InPortData=[{Name: "list", Description: "A list to filter", TypeName: "var[]", TypeRank: -1, DefaultValue: null, DefaultValueEnabled: false}, {Name: "mask", Description: "A list of booleans representing a mask", TypeName: "var[]", TypeRank: -1, DefaultValue: null, DefaultValueEnabled: false}], X=600, Y=100, IsVisible=true, IsUpstreamVisible=true, UpstreamNodeIds=["5", "8"], DownstreamNodeIds=["11"], Excluded=false, HasUI=false, Frozen=false, UsingDefaultValue=false, Name="Filter Sections by Name")  # unwired: list, mask
codeBlock_5 = CodeBlock(X=350, Y=300, IsVisible=true, IsUpstreamVisible=true, DownstreamNodeIds=["12"], Excluded=false, HasUI=false, Frozen=false, UsingDefaultValue=false, Name="Grid Configuration")
# ---------- codeBlock_5.designscript (8 lines) ----------
{
  // CONFIGURE THESE SETTINGS
  startX = 1.0,      // Starting X position on sheet (feet)
  startY = 8.0,      // Starting Y position on sheet (feet)  
  spacingX = 2.8,    // Horizontal spacing between viewports (feet)
  spacingY = 3.8,    // Vertical spacing between viewports (feet)
  maxCols = 2        // Maximum sections per row
};
# ----------------------------------------
codeBlock_6 = CodeBlock(X=800, Y=150, IsVisible=true, IsUpstreamVisible=true, UpstreamNodeIds=["9", "2", "12"], DownstreamNodeIds=["13"], Excluded=false, HasUI=false, Frozen=false, UsingDefaultValue=false, Name="Calculate Positions")  # unwired: sections, sheets, config
# ---------- codeBlock_6.designscript (24 lines) ----------
// Calculate grid positions for multiple sections
sectionCount = Count(sections);
maxCols = config.maxCols;
rows = Math.Ceiling(sectionCount / maxCols);

positions = [];
col = 0;
row = 0;

for(i in 0..sectionCount-1)
{
  x = config.startX + (col * config.spacingX);
  y = config.startY - (row * config.spacingY);
  positions = Append(positions, [x, y]);
  col = col + 1;
  
  if(col >= config.maxCols)
  {
    col = 0;
    row = row + 1;
  }
};

positions;
# ----------------------------------------
codeBlock_7 = CodeBlock(X=500, Y=300, IsVisible=true, IsUpstreamVisible=true, UpstreamNodeIds=["10"], DownstreamNodeIds=["11"], Excluded=false, HasUI=false, Frozen=false, UsingDefaultValue=false, Name="Pass Config") { config; }  # unwired: config
custom_7 = Custom[](InPortData=[{Name: "x", Description: "x to watch", TypeName: "var[]", TypeRank: -1, DefaultValue: null, DefaultValueEnabled: false}], X=1000, Y=150, IsVisible=true, IsUpstreamVisible=true, UpstreamNodeIds=["11"], Excluded=false, HasUI=false, Frozen=false, UsingDefaultValue=false, Name="Viewport Positions")  # unwired: x
codeBlock_8 = CodeBlock(X=350, Y=400, IsVisible=true, IsUpstreamVisible=true, UpstreamNodeIds=["2"], DownstreamNodeIds=["15"], Excluded=false, HasUI=false, Frozen=false, UsingDefaultValue=false, Name="Get First Sheet") { sheets[0]; }  # unwired: sheets
custom_8 = Custom[](InPortData=[{Name: "x", Description: "x to watch", TypeName: "var[]", TypeRank: -1, DefaultValue: null, DefaultValueEnabled: false}], X=500, Y=400, IsVisible=true, IsUpstreamVisible=true, UpstreamNodeIds=["14"], Excluded=false, HasUI=false, Frozen=false, UsingDefaultValue=false, Name="Selected Sheet")  # unwired: x
