# Dynamo graph Rename_Levels_UpperLower_v02..dyn "CHANGE LEVELS CASE TO UPPER" (Dynamo 3.3.0.6316)

# group: HOW TO USE THIS GRAPH > What this graph does: It renames every Level in the model to all UPPERCASE or all lowercase.
# note: Note 1

# group: HOW TO USE THIS GRAPH > How to use it: Look at the list in Step 2 to see the current Level names. In Step 3, flip the switch: True = UPPERCASE, False = lowercase. Then press Run.
# note: Note 2

# group: HOW TO USE THIS GRAPH > Warning: Step 4 changes the model for real. If you make a mistake, press Ctrl+Z in Revit right away to undo it.
# note: Note 3

# group: Step 1: Find all Levels in the model
string = StringInput("Levels")
byName = Category.ByName(name=string)
all_elements_of_category = ElementsOfCategory(Category=byName)

# group: Parameter to change: Name
code_block = CodeBlock { "Name"; }

# group: Step 2: Read current Level names
getParameterValueByName = Element.GetParameterValueByName(element=all_elements_of_category, parameterName=code_block)

# group: Step 3: Choose UPPERCASE or lowercase
# note: This renames every Level in the model to uppercase or lowercase — flip the True/False switch below to choose.
boolean = BoolSelector(true)
changeCase = String.ChangeCase(string=getParameterValueByName, upper=boolean)

# group (continued): Step 2: Read current Level names
watch = Watch(changeCase)

# group: Step 4: Write new names back to the Levels
setParameterByName = Element.SetParameterByName(element=all_elements_of_category, parameterName=code_block, value=watch)
