# Dynamo graph Rename_Selection_PrefixSuffixReplace.dyn (Dynamo 3.3.0.6316)
# packages: Clockwork for Dynamo 1.x 1.34.0, Clockwork for Dynamo 2.x 2.12.3, spring nodes 210.1.1

# group: HOW TO USE: > Warning: This changes the names in the model for real. If you make a mistake, press Ctrl+Z in Revit right away to undo it.
# note: Note 3

# group: HOW TO USE: > What this graph does: It renames the elements you have selected in Revit. It adds text to the front and back of the name, and can swap out any text you want changed. Before you run it: Select the elements you want to rename in Revit first. Then flip the refresh toggle in Step 2 off and on again ,if you skip this, the graph will use your old selection and nothing will change.
# note: Note 1

# group: HOW TO USE: > How to use it: 1.Select your elements in Revit. 2.FLip the refresh toggle off, then on. 3.Type your text in the four boxes: Prefix (goes in front), Suffix (goes at the end), Find (the text to look for), Replace (what to change it to). 4.Leave a box empty if you don't need it. 5.Press Run.
# note: Note 2

# group: Step 1: Type what you want to add and replace
prefix = StringInput("")  # graph input
suffix = StringInput("")  # graph input
find = StringInput("Copy 1")  # graph input
replace = StringInput("+ ARCH UNDERLAY")  # graph input

# group: Step 2: Uses whatever you selected in Revit
ꟿ_collect_currentselection = Custom[ꟿ Collect.CurrentSelection]()  # package spring nodes

# group: Step 3: Read current names
name = Custom[Element.Name+](element=ꟿ_collect_currentselection)  # package Clockwork for Dynamo 1.x; Gets an element's name. Unlike the OOTB node, this node should work for *all* Revit elements that have names and will also return the localized names of system parameters, parameter groups, display unit types, parameter types, unit symbol types, unit types and ForgeTypeIds.

# group: Step 4: Build the new name
code_block = CodeBlock(Pref=prefix, originalName=name, Suf=suffix) { Pref + originalName + Suf; }
replaceMultiple = Custom[String.ReplaceMultiple](str=code_block, searchFor=find, replaceWith=replace, sortSearchTermsBySize=ꟿ_collect_currentselection)  # package Clockwork for Dynamo 2.x; Replaces multiple search terms in a given string with multiple replacements

# group: Step 5: Write new names back
setName = Custom[Element.SetName](name=replaceMultiple)  # package Clockwork for Dynamo 1.x; Gets the name of a given Revit element; unwired: element
